# Grasshopper definition StudFrame_face.gh (Grasshopper 1.0.7)
# plug-ins: Pufferfish

# ---- group: Center Object
srf = Surface(<surface referenced from the Rhino model>)
bbox = BoundingBox(Content=srf, Plane=PlaneXY(0, 0, 0))  # -> Box, Box_2
volume = Volume(Geometry=bbox.Box)  # -> Volume, Centroid
neg = Negative(Value=volume.Centroid)
move = Move(Geometry=srf, Motion=neg)  # -> Geometry, Transform

# ----
debrep = DeconstructBrep(Brep=move.Geometry)  # -> Faces, Edges, Vertices

# ---- group: Input Slat Guid Direction
vec = VectorXYZ(XComponent=Slider(0, range=-1..1), YComponent=Slider(0, range=-1..1), ZComponent=Slider(0.2, range=-1..1))  # -> Vector, Length
len = Length(Curve=debrep.Edges)
unit = UnitVector(Vector=vec.Vector)
xy = XYPlane(Origin=Point(0, 0, 0))
avr = Average(Input=len)
line = LineSDL(Start=xy, Direction=unit, Length=avr)

# ---- group: Frames at end points
panel = Panel("""0
1""")
pframe = PerpFrame(Curve=reparameterize(debrep.Edges), Parameter=graft(panel))  # -> simplify(Frame)
crv = Curve(debrep.Edges)
bang = ExplodeTree(Data=pframe)  # -> Branch0, Branch1

# ---- group: Visualize Check Heirarchy
midpt = CurveMiddle(Curve=debrep.Edges)
shift = ShiftList(List=midpt, Shift=1, Wrap=True)
ln = Line(StartPoint=midpt, EndPoint=shift)
end = EndPoints(Curve=ln)  # -> Start, End
vdis = VectorDisplay(Anchor=end.Start, Vector=ln)

# ---- group: Which Should Take the load
angle = Angle(VectorA=bang.Branch1, VectorB=unit)  # -> Angle, Reflex
angle_2 = Angle(VectorA=bang.Branch0, VectorB=unit)  # -> Angle, Reflex
subtraction = Subtraction(A=angle_2.Reflex, B="pi")
subtraction_2 = Subtraction(A=angle.Reflex, B="pi")
min = Minimum(A=angle.Angle, B=subtraction_2)
min_2 = Minimum(A=angle_2.Angle, B=subtraction)
shift_2 = ShiftList(List=min, Shift=1, Wrap=True)
smaller = SmallerThan(FirstNumber=min_2, SecondNumber=shift_2)  # -> SmallerThan, OrEqualTo

# ---- group: Shorten boards for butt joint
not = GateNot(A=smaller.SmallerThan)
multiplication = Multiplication(A=smaller.SmallerThan, B="-4")
multiplication_2 = Multiplication(A=not, B="-4")
shift_3 = ShiftList(List=multiplication_2, Shift="-1", Wrap=True)
ext = ExtendCurve(Curve=crv, Type=0, Start=shift_3, End=multiplication)

# ----
pframe_2 = PerpFrame(Curve=reparameterize(ext), Parameter=".5")
srf_cp = SurfaceClosestPoint(Point=pframe_2, Surface=move.Geometry)  # -> Point, UVPoint, Distance
debrep_2 = DeconstructBrep(Brep=move.Geometry)  # -> Faces, Edges, Vertices
evalsrf = EvaluateSurface(Surface=move.Geometry, Point=srf_cp.UVPoint)  # -> Point, Normal, UDirection, VDirection, Frame
join = JoinCurves(Curves=debrep_2.Edges, Preserve=False)
align = AlignPlane(Plane=pframe_2, Direction=evalsrf.Normal)  # -> Plane, Angle
deplane = DeconstructPlane(Plane=align.Plane)  # -> Origin, XAxis, YAxis, ZAxis
sort = SortList()  # -> Keys, ValuesA
number_slider = Slider(4, range=0..10)
offsets = OffsetOnSrf(Curve=join, Distance=number_slider, Surface=move.Geometry)
srfsplit = SurfaceSplit(Surface=move.Geometry, Curves=offsets)
debrep_3 = DeconstructBrep(Brep=offsets)  # -> Faces, Edges, Vertices
item = ListItem(List=srfsplit, Index=0, Wrap=True)  # -> Item, Item1
plcoord = PlaneCoordinates(Point=debrep_3.Vertices, System=PlaneXY(0, 0, 0))  # -> XCoordinate, YCoordinate, ZCoordinate
amp = Amplitude(Vector=deplane.XAxis, Amplitude=Slider(8, range=0..10))
contour = Contour(Shape=item.Item1, Point=Point(0, 0, 0), Direction=Vector(0, 0, 1))
extr = Extrude(Base=ext, Direction=amp)
offsrf = OffsetSurface(Surface=extr, Distance=number_slider, BothSides=False, CreateSolid=True)  # -> simplify(Offset)
