# Grasshopper definition StudJoint_crv.gh (Grasshopper 1.0.7)

crv = Curve(<curve referenced from the Rhino model>)
explode = Explode(Curve=crv, Recursive=True)  # -> Segments, Vertices
shift = ShiftList(List=explode.Segments, Shift=1, Wrap=True)  # -> graft(List)
shift_2 = ShiftList(List=explode.Segments, Shift="-1", Wrap=True)  # -> graft(List)
merge = Merge(Data1=shift_2, Data2=shift)
number_slider = Slider(0, range=0..10)
neigbors_crv = Curve(simplify(merge))
crv_2 = Curve(simplify(graft(explode.Segments)))
branch = TreeBranch(Tree=neigbors_crv, Path=number_slider, MaintainPaths=True)
branch_2 = TreeBranch(Tree=crv_2, Path=number_slider, MaintainPaths=True)

# ---- group: Center Object
bbox = BoundingBox(Content=branch_2, Plane=PlaneXY(0, 0, 0), UnionBox=True)  # -> Box, Box_2
volume = Volume(Geometry=bbox.Box)  # -> Volume, Centroid
neg = Negative(Value=volume.Centroid)
move = Move(Geometry=branch_2, Motion=neg)  # -> Geometry, Transform

# ----
transform = Transform(Geometry=branch, Transform=move.Transform)
number_slider_2 = Slider(2, range=0..10)
number_slider_3 = Slider(4, range=0..10)
neigbors_crv_2 = Curve(reparameterize(simplify(transform)))
crv_3 = Curve(reparameterize(simplify(move.Geometry)))
pframe = PerpFrame(Curve=crv_3, Parameter=".5")
